# Dynamo graph Beam.dyn (Dynamo 2.0.2.6826)

# group: AxModel
startAxModel = DyToAxisVM.AxModel.StartAxModel()

# group: Create a line
byCoordinates = Point.ByCoordinates()
number_slider_span_of_beam = DoubleSlider(13.3, range=0..100 step 0.1)
byCoordinates_2 = Point.ByCoordinates(x=number_slider_span_of_beam)
byStartPointEndPoint = Line.ByStartPointEndPoint(startPoint=byCoordinates, endPoint=byCoordinates_2)

# group: Export lines
boolean = BoolSelector(false)
sendLines = DyToAxisVM.ExportOptions.SendLines(AxModel=startAxModel, b=boolean, ln=byStartPointEndPoint)

# group: Create structural member: AxMember
string = StringInput("S 235")
string_2 = StringInput("IPE 240")
string_3 = StringInput("beam")
byProperties = DyToAxisVM.AxMember.ByProperties(line=byStartPointEndPoint, material=string, crossSection=string_2, type=string_3)

# group: Export structural elements
boolean_2 = BoolSelector(false)
sendMembers = DyToAxisVM.ExportOptions.SendMembers(AxModel=startAxModel, b=boolean_2, axm=byProperties)

# group: ------------------------------------- HOW TO GET STARTED 2. To start the export, connect a Boolean input node to the AxisVM Export nodes (SendLines or SendMembers) and set it to True. An AxisVM window will soon open with the exported model in it. In case of larger models, this may take several seconds. -------------------------------------
boolean_3 = BoolSelector(false)

# group: ---------------------------------HOW TO GET STARTED 1. When the geometry is defined, you can start creating the AxisVM model. For this, use the StartAxModel node. Connect this to any other AxisVM modelling node. ---------------------------------
startAxModel_2 = DyToAxisVM.AxModel.StartAxModel()
